% Simulink data dictionary AION_IDS.sldd
% references Model_Config.sldd
% references Common_Definition.sldd

ADCU_OutputBus = Simulink.Bus()
  OutputCAN_bus: Bus: OutputCAN

CONTROL_CYCLE_TIME = 0.02
SCU_ADCU_CYCLE_TIME = 0.02
ADCU_SCU_CYCLE_TIME = 0.02
steer_angle_test = 3
longitudinal_control_request_test = 0
steer_torque_test = 0
gear_test = 1
lateral_control_request_test = 1

Available_status = enum(DefaultValue="NotAvailable")  % 横纵向控制功能状态
  NotAvailable = 0  % Not_Available
  Available = 1  % Available

Fault_status = enum(DefaultValue="NotFault")
  NotFault = 0  % No Fault
  Fault = 1  % Fault

Open_status = enum(DefaultValue="Closed")
  Closed = 0  % Closed
  Open = 1  % Open

Error_status = enum(DefaultValue="NoError")
  NoError = 0  % No Error
  Error = 1  % Error

Pressed_status = enum(DefaultValue="NotPressed")
  NotPressed = 0  % Not pressed
  Pressed = 1  % Pressed

Ward_status = enum(DefaultValue="Forward")
  Forward = 0  % Forward
  Backward = 1  % Backward

Ready_status = enum(DefaultValue="NotReady")
  NotReady = 0  % Not Ready
  Ready = 1  % Ready

Failure_status = enum(DefaultValue="NoFailure")
  NoFailure = 0  % No Failure
  enum2 = 1  % Failure

Intervention_status = enum(DefaultValue="WithoutIntervention")
  WithoutIntervention = 0  % Without Intervention
  WithIntervention = 1  % With Intervention

Control_request = enum(DefaultValue="Manual")  % 横纵向控制请求指令
  Manual = 0
  Auto = 1
  Reserved = 2
  Reserved1 = 3

Control_status = enum(DefaultValue="ManualStatus")  % 横纵向控制功能状态
  ManualStatus = 0  % Manual
  QuitStatus = 1  % Quit
  AutoStatus = 2  % Auto
  FaultStatus = 3  % Fault

Beam_request = enum(DefaultValue="NoBeamRequest")  % 横纵向控制功能状态
  NoBeamRequest = 0  % No request
  LowBeam = 1  % Low beam request
  HighBeam = 2  % High beam request
  BeamReserved = 3  % Reserved

Enable_request = enum(DefaultValue="Disable")
  Disable = 0  % Disable
  Enable = 1  % Enable

Light_request = enum(DefaultValue="NoLightRequest")
  NoLightRequest = 0  % No request
  TurnLeftLight = 1  % Turn left light
  TurnRightLight = 2  % Turn right light
  EmergencyLight = 3

Active_request = enum(DefaultValue="NotActiveRequest")
  NotActiveRequest = 0  % NotActive
  ActiveRequest = 1

ADCU3_SCU_CYCLE_TIME = 0.05

Gear_status = enum(DefaultValue="InvalidGearStatus")
  InvalidGearStatus = 0  % 无效
  DriveGearStatus = 1  % D
  NeutralGearStatus = 2  % N
  ReverseGearStatus = 3  % R
  ParkGearStatus = 4  % P

Gear_request = enum(DefaultValue="NoRequest")  % 档位
  NoRequest = 0  % 无请求
  P = 1  % P档
  R = 2  % R档
  N = 3  % N档
  D = 4  % D档
  Reserved_gear = 5  % 保留
  Reserved1_gear = 6  % 保留
  Reserved2_gear = 7  % 保留

Active_status = enum(DefaultValue="NotActiveStatus")  % 横纵向控制功能状态
  NotActiveStatus = 0  % Not_active
  ActiveStatus = 1  % Active

Drive_status = enum(DefaultValue="InvalidDriveStatus")
  InvalidDriveStatus = 0  % 无效
  EcoPlusModeStatus = 1  % ECO+
  EcoModeStatus = 2  % ECO
  NormalModeStatus = 3  % Normal
  DrivingModeStatus = 4  % Driving
  SportModeStatus = 5  % Sport

Validation_status = enum(DefaultValue="Invalid")  % 有效性
  Invalid = 0  % 无效
  Valid = 1  % 有效

AutoTrqWhlReq_test = 130
BeamReq_test = 0
TurnLightReq_test = 0
HornRingReq_test = 0

ADCU2SCU_ADCU_1 = Simulink.Bus()
  ADCU_AutoTrqWhlReq: double, Min=-5000, Max=5000, Unit="Nm"  % 自动驾驶模式下的扭矩请求，单位Nm，只在纵向处于自动控制模式时有效
  ADCU_BrakeReq: double, Min=-16, Max=16, Unit="m/s^2"  % 自动驾驶模式下的制动加速度控制指令，单位m/s^2，只在纵向处于自动控制模式时有效
  ADCU_GearLvlReq: double, Min=0, Max=7  % 挡位请求指令，处于P挡时，车辆将自动拉起手刹，，只在纵向处于自动控制模式时有效
  ADCU_GearLvlReqVD: double, Min=0, Max=1  % 挡位请求有效、无效指令
  ADCU_LngCtrlReq: double, Min=0, Max=3  % 纵向控制请求进入手动、自动的指令

ADCU2SCU_ADCU_3 = Simulink.Bus()
  ADCU_BeamReq: double, Min=0, Max=3, Unit="-"  % 近光灯、远光灯控制请求
  ADCU_BodyCtrlReq: double, Min=0, Max=1, Unit="-"  % 车身电子控制请求激活、退出指令
  ADCU_HornRingReq: double, Min=0, Max=1, Unit="-"  % 喇叭控制请求
  ADCU_TurnLightReq: double, Min=0, Max=3, Unit="-"  % 转向灯、双闪灯控制请求指令

SCU2ADCU_SCU_1 = Simulink.Bus()
  BCS_ABSActiveSt: double, Min=0, Max=1, Unit="-"  % ABS激活状态反馈值
  BCS_VehSpd: double, Min=0, Max=240, Unit="km/h"  % 车速信号
  BCS_VehSpdVD: double, Min=0, Max=1, Unit="-"  % 车速信号的有效性判断

SCU2ADCU_SCU_10 = Simulink.Bus()
  EPS_SteeringAngle: double, Min=-780, Max=779.9, Unit="deg"  % 方向盘转角实际值
  EPS_SteeringAngleSpd: double, Min=0, Max=1016, Unit="deg/sec"  % 方向盘转角速度
  EPS_SteeringAngleSpdVD: double, Min=0, Max=1  % 方向盘转角速度实际值的有效性判断
  EPS_SteeringAngleVD: double, Min=0, Max=1  % 方向盘转角实际值有效性判断
  EPS_StrngWhlTorq: double, Min=-12.5, Max=12.5, Unit="Nm"  % 助力扭矩

SCU2ADCU_SCU_11 = Simulink.Bus()
  BCM_CtrlAvailable: double, Min=0, Max=1  % 车身电子控制状态
  BCM_HazardLampSt: double, Min=0, Max=1  % 双闪灯状态
  BCM_HighBeamSt: double, Min=0, Max=1  % 远光灯状态
  BCM_HornSt: double, Min=0, Max=1  % 喇叭状态
  BCM_KeySt: double, Min=0, Max=3  % 整车上电状态
  BCM_LeftTurnLampSt: double, Min=0, Max=1  % 左转向灯状态
  BCM_LowBeamSt: double, Min=0, Max=1  % 近光灯状态
  BCM_RightTurnLampSt: double, Min=0, Max=1  % 右转向灯状态

SCU2ADCU_SCU_12 = Simulink.Bus()
  SRS_DriverSeatBeltSt: double, Min=0, Max=3  % 驾驶位安全带状态
  SRS_PsngrSeatBeltSt: double, Min=0, Max=3  % 副驾驶位安全带状态

SCU2ADCU_SCU_13 = Simulink.Bus()
  SCU_LatAutoCheckReport: double, Min=0, Max=15  % 是否满足横向控制从手动切换为自动的激活条件的反馈
  SCU_LatCtrlMode: double, Min=0, Max=3  % 纵向控制模式
  SCU_LatQuitReport: double, Min=0, Max=255  % 横向控制非预期从自动切换为退出的反馈
  SCU_LngAutoChecklReport: double, Min=0, Max=65535  % 是否满足纵向控制从手动切换为自动的激活条件的反馈
  SCU_LngCtrlMode: double, Min=0, Max=3  % 纵向控制模式
  SCU_LngQuitReport: double, Min=0, Max=65535  % 纵向控制非预期从自动切换为退出的反馈
  SCU_StrngWhlIntv: double, Min=0, Max=1  % 方向盘干预状态反馈
  VCU_GearLeverIntv: double, Min=0, Max=1  % 挡位干预状态反馈

SCU2ADCU_SCU_14 = Simulink.Bus()
  VCU_VehDrvMod: double, Min=0, Max=7, Unit="-"  % 车辆行驶模式
  VCU_VehRdySt: double, Min=0, Max=1, Unit="-"  % 整车ready状态
  VCU_VehRng: double, Min=0, Max=1000, Unit="km"  % 续航里程

SCU2ADCU_SCU_15 = Simulink.Bus()
  VCU_CrntGearLvl: double, Min=0, Max=7  % 实际挡位信号
  VCU_CrntGearLvlVD: double, Min=0, Max=1  % 实际挡位信号的有效性判断

SCU2ADCU_SCU_16 = Simulink.Bus()
  VCU_ActVehWheelTorq: double, Min=0, Max=10000, Unit="Nm"  % 轮端扭矩的实际值

SCU2ADCU_SCU_18 = Simulink.Bus()
  VCU_BrkPedalSt: double, Min=0, Max=1  % 制动踏板被踩下的状态反馈

SCU2ADCU_SCU_3 = Simulink.Bus()
  BCS_YawRate: double, Min=-2.0943, Max=1.9047234375, Unit="rad/s"  % 横摆角速度

SCU2ADCU_SCU_8 = Simulink.Bus()
  BCS_ActVehLaltrlAccel: double, Min=-21.593, Max=21.593, Unit="m/s^2"  % 横向加速度实际值
  BCS_ActVehLongAccel: double, Min=-21.593, Max=21.593, Unit="m/s^2"  % 纵向加速度实际值

SCU2ADCU_SCU_9 = Simulink.Bus()
  EPB_SysSt: double, Min=0, Max=7  % EPB系统状态值

ADCU2SCU = Simulink.Bus()  % ADCU发送到SCU的CAN总线
  ADCU_1: Bus:ADCU2SCU_ADCU_1
  ADCU_2: Bus:ADCU2SCU_ADCU_2
  ADCU_3: Bus:ADCU2SCU_ADCU_3

SCU2ADCU = Simulink.Bus()  % SCU发送到ADCU的CAN总线
  SCU_1: Bus:SCU2ADCU_SCU_1
  SCU_10: Bus:SCU2ADCU_SCU_10
  SCU_11: Bus:SCU2ADCU_SCU_11
  SCU_12: Bus:SCU2ADCU_SCU_12
  SCU_13: Bus:SCU2ADCU_SCU_13
  SCU_14: Bus:SCU2ADCU_SCU_14
  SCU_15: Bus:SCU2ADCU_SCU_15
  SCU_16: Bus:SCU2ADCU_SCU_16
  SCU_17: Bus:SCU2ADCU_SCU_17
  SCU_18: Bus:SCU2ADCU_SCU_18
  SCU_3: Bus:SCU2ADCU_SCU_3
  SCU_8: Bus:SCU2ADCU_SCU_8
  SCU_9: Bus:SCU2ADCU_SCU_9

ADCU_Info = Simulink.Bus()  % ADCU发送消息中除了横向和纵向控制之外的消息
  set_Checksum1: uint32, Min=0, Max=255  % Message checksum
  set_MsgCounter1: uint32, Min=0, Max=15  % Message counter of ADCU_1
  set_Checksum2: uint32, Min=0, Max=255  % Message checksum
  set_MsgCounter2: uint32, Min=0, Max=15  % Message counter of ADCU_2
  set_Checksum3: uint32, Min=0, Max=255, Unit="-"  % Message checksum
  set_MsgCounter3: uint32, Min=0, Max=15, Unit="-"  % Message counter of ADCU_3
  set_BeamReq: Enum: Beam_request, Unit="-"  % Low / High beam control request
  set_BodyCtrlReq: Enum: Enable_request, Unit="-"  % Enable vehicle body control
  set_HornRingReq: Enum: Active_request, Unit="-"  % Horn control request
  set_TurnLightReq: Enum: Light_request, Unit="-"  % Turn light control request

BCM_Info = Simulink.Bus()
  get_CtrlAvailable: Enum: Available_status  % Body control is available
  get_HazardLampSt: Enum: Active_status  % Hazard lamp status
  get_HighBeamSt: Enum: Active_status  % High beam status
  get_HornSt: Enum: Active_status  % Horn status
  get_KeySt: uint8, Min=0, Max=3  % Ignition key position status
  get_LeftTurnLampSt: Enum: Active_status  % Left turn lamp status
  get_LowBeamSt: Enum: Active_status  % Low beam status
  get_RightTurnLampSt: Enum: Active_status  % Right turn lamp status

BCS_Info = Simulink.Bus()
  get_ABSActiveSt: uint8, Min=0, Max=1, Unit="-"  % Indication that ABS system currently performs a brake intervention
  get_VehSpd: double, Min=0, Max=240, Unit="km/h"  % Vehicle speed
  get_VehSpdVD: uint8, Min=0, Max=1, Unit="-"  % Quality/fault information to vehicle speed
  get_YawRate: double, Min=-2.0943, Max=1.9047234375, Unit="rad/s"  % Yaw rate
  get_ActVehLaltrlAccel: double, Min=-21.593, Max=21.593, Unit="m/s^2"  % Actual vehicle lateral acceleration
  get_ActVehLongAccel: double, Min=-21.593, Max=21.593, Unit="m/s^2"  % Actual vehicle longitudinal acceleration

EPB_Info = Simulink.Bus()
  get_SysSt: uint8, Min=0, Max=7  % EPB system status

EPS_Info = Simulink.Bus()
  get_SteeringAngle: double, Min=-780, Max=779.9, Unit="deg"  % Steering wheel angle
  get_SteeringAngleSpd: uint32, Min=0, Max=1016, Unit="deg/sec"  % steering wheel angle speed
  get_SteeringAngleSpdVD: uint8, Min=0, Max=1  % Steering wheel angle speed valid value
  get_SteeringAngleVD: uint8, Min=0, Max=1  % Steering wheel angle valid value
  get_StrngWhlTorq: double, Min=-12.5, Max=12.5, Unit="Nm"  % Steering wheel Torque

SCU_Info = Simulink.Bus()
  get_LatAutoCheckReport: uint32, Min=0, Max=15  % Check report for Lateral control request(MANUAL->AUTO)
  get_LatCtrlMode: Enum: Control_status  % Lateral control mode
  get_LatQuitReport: uint32, Min=0, Max=255  % Lateral control quit report(Auto->Quit).
  get_LngAutoCheckIReport: uint32, Min=0, Max=65535  % Check report for Longitudinal control request(MANUAL->AUTO).
  get_LngCtrlMode: Enum: Control_status  % Longitudinal control mode
  get_LngQuitReport: uint32, Min=0, Max=65535  % Longitudinal control quit report(Auto->Quit).
  get_StrngWhlIntv: uint8, Min=0, Max=1  % Steering wheel intervention

SRS_Info = Simulink.Bus()
  get_DriverSeatBeltSt: uint8, Min=0, Max=3  % To identify whether Driver Seat Belt is buckled
  get_PsngrSeatBeltSt: uint8, Min=0, Max=3  % To identify whether Passenger Seat Belt is buckled

AION_Longitudinal_Control_Info = Simulink.Bus()  % 纵向控制信息
  set_LngCtrlReq: Enum: Control_request  % longitudinal_control_request
  set_AutoTrqWhlReq: double, Min=0, Max=5000  % torque_request,扭矩请求
  set_BrakeReq: double, Min=-16, Max=16  % brake_request
  set_GearLvlReq: Enum: Gear_request  % 目标档位（正整数，无量纲）gear_level_request
  set_GearLvlReqVD: Enum: Validation_status  % gear_level_request_valid

BodyCtrlReq_test = 0

AION_Lateral_Control_Info = Simulink.Bus()  % 纵向控制信息
  set_LatCtrlReq: Enum: Control_request  % lateral_control_request
  set_SteerAngReq: double  % steer_angle_request
  set_SteerWhlTorqReq: double

ADCU2SCU_ADCU_2 = Simulink.Bus()
  ADCU_LatCtrlReq: double, Min=0, Max=1, Unit="-"  % 纵向控制请求进入手动、自动的指令
  ADCU_SteerAngReq: double, Min=-780, Max=779.9, Unit="deg"  % 方向盘转角请求，左“+”右“-”，单位为deg，只在横向处于自动控制模式时有效
  ADCU_SteerWhlTorqReq: double

SteerWhlTorqReq_test = 0
SteerAngReq_test = -221.9318
BrakeReq_test = 0
GearLvlReq_test = 0
GearLvlReqVD_test = 0
IDS_GNSS_CYCLE_TIME = 0.02
COMMUNICATION_CYCLE_TIME = 0.05
O_ALTITUDE = 0
O_LATITUDE = 0
O_LONGITUDE = 0

ADCU_InputBus = Simulink.Bus()
  InputCAN_bus: Bus: InputCAN
  InputSerial_bus: Bus: InputSerial

InputCAN = Simulink.Bus()  % 输入CAN接口
  SCU2ADCU_bus: Bus: SCU2ADCU  % VCU到IDS的输入接口
  IMU2ADCU_bus: Bus: IMU2ADCU

IMU_ADCU_CYCLE_TIME = 0.02

IMU_Status = enum(DefaultValue="Initialization")  % 组合惯导工作状态
  Initialization = 0  % 初始化
  Single_Point_Location = 3  % 单点定位
  Single_Point_Orientation = 4  % 单点定向
  RTK_INT_Location = 69  % RTK固定解定位
  RTK_INT_Orientation = 75  % RTK固定解定向
  RTK_FLOAT_Location = 85  % RTK浮点解定位
  RTK_FLOAT_Orientation = 91  % RTK浮点解定向

IMU_Info = Simulink.Bus()  % 应用层的IMU信号
  get_GPSWeek: double
  get_GPSTime: double, Min=0, Unit="s"  % 组合惯导秒数（从本周日0:00:00至当前的秒数，精确到毫秒）
  get_Heading: double, Min=0, Max=359.99, Unit="°"  % 组合惯导航向角
  get_Pitch: double, Min=-90, Max=90, Unit="°"  % 组合惯导俯仰角
  get_Roll: double, Min=-180, Max=180, Unit="°"  % 组合惯导横滚角
  get_IMUWorkStatus: Enum: IMU_Status  % 组合惯导工作状态
  get_AngleSpeedX: double, Min=-360, Max=360, Unit="°/s"  % 组合惯导X角速度
  get_AngleSpeedY: double, Min=-360, Max=360, Unit="°/s"  % 组合惯导Y角速度
  get_AngleSpeedZ: double, Min=-360, Max=360, Unit="°/s"  % 组合惯导Z角速度
  get_AccelerationX: double, Min=-10, Max=10, Unit="g"  % 组合惯导X加速度
  get_AccelerationY: double, Min=-10, Max=10, Unit="g"  % 组合惯导Y加速度
  get_AccelerationZ: double, Min=-10, Max=10, Unit="g"  % 组合惯导Z加速度
  get_Latitude: double, Min=-90, Max=90, Unit="°"  % 组合惯导纬度
  get_Longitude: double, Min=-180, Max=180, Unit="°"  % 组合惯导经度
  get_Altitude: double, Min=-200, Max=8000, Unit="m"  % 组合惯导高度

IMU2ADCU = Simulink.Bus()  % IMU到ADCU的输入接口
  GPSWeek: double
  GPSTime: double, Min=0, Unit="s"  % 组合惯导秒数（从本周日0:00:00至当前的秒数，精确到毫秒）
  Heading: double, Min=0, Max=359.99, Unit="°"  % 组合惯导航向角
  Pitch: double, Min=-90, Max=90, Unit="°"  % 组合惯导俯仰角
  Roll: double, Min=-180, Max=180, Unit="°"  % 组合惯导横滚角
  IMUWorkStatus: double  % 组合惯导工作状态
  AngleSpeedX: double, Min=-360, Max=360, Unit="°/s"  % 组合惯导X角速度
  AngleSpeedY: double, Min=-360, Max=360, Unit="°/s"  % 组合惯导Y角速度
  AngleSpeedZ: double, Min=-360, Max=360, Unit="°/s"  % 组合惯导Z角速度
  AccelerationX: double, Min=-10, Max=10, Unit="g"  % 组合惯导X加速度
  AccelerationY: double, Min=-10, Max=10, Unit="g"  % 组合惯导Y加速度
  AccelerationZ: double, Min=-10, Max=10, Unit="g"  % 组合惯导Z加速度
  Latitude: double, Min=-90, Max=90, Unit="°"  % 组合惯导纬度
  Longitude: double, Min=-180, Max=180, Unit="°"  % 组合惯导经度
  Altitude: double, Min=-200, Max=8000, Unit="m"  % 组合惯导高度

InputSerial = Simulink.Bus()
  IMUSerial_bus: Bus: IMU2ADCU

ADCU2SPK = Simulink.Bus()  % Qlight喇叭控制消息
  ADCU_Stx: double
  ADCU_FunctionCode: double
  ADCU_SoundSourceCode: double
  ADCU_VolumeCode: double
  ADCU_Parameter: double
  ADCU_Chk: double
  ADCU_Etx: double

OutputCAN = Simulink.Bus()  % 输出CAN接口
  ADCU2SCU_bus: Bus: ADCU2SCU  % IDS到VCU的输出接口
  ADCU2SPK_bus: Bus: ADCU2SPK

SPK_Info = Simulink.Bus()
  set_Stx: double
  set_FunctionCode: double
  set_SoundSourceCode: double
  set_VolumeCode: double
  set_Parameter: double
  set_Chk: double
  set_Etx: double

AION_ApplicationBus = Simulink.Bus()  % 适配AION车的IDS应用层总线
  set_lateral_control_info: Bus: AION_Lateral_Control_Info
  set_longitudinal_control_info: Bus: AION_Longitudinal_Control_Info  % 纵向控制信息
  set_ADCU_info: Bus: ADCU_Info
  set_SPK_info: Bus: SPK_Info
  get_BCS_info: Bus: BCS_Info  % 制动系统信号
  get_VCU_info: Bus: VCU_Info
  get_SCU_info: Bus: SCU_Info
  get_EPB_info: Bus: EPB_Info  % 驻车系统信息
  get_SRS_info: Bus: SRS_Info
  get_EPS_info: Bus: EPS_Info
  get_BCM_info: Bus: BCM_Info
  get_IMU_info: Bus: IMU_Info

SPK_Chk = 76
LatCtrlReq_test = 0
LngCtrlReq_test = 0

SCU2ADCU_SCU_17 = Simulink.Bus()
  VCU_AccElecECFail: double, Min=0, Max=1, Unit="-"  % 驱动系统故障
  VCU_GasPedalActPst: double, Min=0, Max=99.96, Unit="%"  % 油门踏板实际位置
  VCU_VehWheelTorqMax: double, Min=0, Max=10000, Unit="Nm"  % 驱动系统允许的最大扭矩值
  VCU_ACCButtInfo: double, Min=0, Max=255  % SCU控车时，方向盘按键预留信号

VCU_Info = Simulink.Bus()
  get_ActVehWheelTorq: uint32, Min=0, Max=10000, Unit="Nm"  % Actual effective engine torque on wheel level
  get_GearLeverIntv: uint8, Min=0, Max=1  % Gear intervention
  get_VehDrvMod: Enum: Drive_status, Unit="-"  % Drive mode for display
  get_VehRdySt: Enum: Ready_status, Unit="-"  % HEV system ready status
  get_VehRng: uint32, Min=0, Max=1000, Unit="km"  % Total range for display
  get_CrntGearLvl: Enum: Gear_status  % VCU current carry out gear level
  get_CrntGearLvlVD: uint8, Min=0, Max=1  % VCU current carry out gear level valid data
  get_GasPedalActPst: double, Min=0, Max=100  % 油门踏板百分比实际值
  get_AccElecECFail: uint8, Min=0, Max=1, Unit="-"  % Indicate the error state of electronic engine control.
  get_VehWheelTorqMax: uint32, Min=0, Max=10000, Unit="Nm"  % Actual effective maximum adjustable torque on wheel level
  get_BrkPedalSt: uint8, Min=0, Max=1  % Brake pedal status
  get_ACCButtInfo: uint32, Min=0, Max=255  % SCU控车时，方向盘按键预留信号

SPK_SoundSourceCode = 1
ADCU_SPK_CYCLE_TIME = 0.2